# Grasshopper definition OpenLB.ghx (Grasshopper 1.0.8)
# plug-ins: Eddy3D-LBM, Outdoor

lbm_run_settings = LBMRunSettings(
    GridSpacing="6",
    Warmup=60,
    Averaging=120,
    ProbeHeight=1.5,
    ProbeSpacing=2,
    GPU=True,
    Runtime="Auto",
    Jitter=True,
    JitterAmplitude=5,
    VegetationDrag=0.25,
    PerturbedInflow=False,
    Ensemble=5,
    VegetationDensity="Custom (Vegetation Drag input)")
geometry = Geometry([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])
atmospheric_boundary_layer = AtmosphericBoundaryLayer(
    ReferenceHeight=10,
    RoughnessLengthZ0=1,
    GroundHeight=0,
    TurbulentKEK=0.015,
    TurbulentEpsilonΕ=0.135,
    TurbulentOmegaΩ=100,
    TerrainType="Custom (z0 input)",
    AblOutputLayoutVersion=2)  # -> BoundaryConditions, WindVectors
preview = CustomPreview(Geometry=geometry, Material=ColourSwatch(SwatchColor=RGB(255, 255, 255)))
lbm_run = LBMRun(
    CaseName="OpenLB",
    ABL=atmospheric_boundary_layer.BoundaryConditions,
    Buildings=geometry,
    Settings=lbm_run_settings,
    Clear=False,
    Prepare=False,
    Run=False,
    LbmInputLayoutVersion=6)  # -> Logs, Case, Domain
lbm_field = LBMField(Case=lbm_run.Case, Refresh=Button())  # -> Points, Velocity, Speed, Status, Spread
wires = BrepWireframe(Brep=lbm_run.Domain, Density=-1)
panel = Panel(lbm_run.Logs)
vector_field_viewer = VectorFieldViewer(
    Points=lbm_field.Points,
    Velocity=lbm_field.Velocity,
    DisplayMode="Vector Field",
    Scale=1,
    ColorMap="Turbo",
    SeedCount=120,
    ArrowheadScaling="Linear",
    VectorPlane="3D")  # -> Geometry, Colors, Range
