# Grasshopper definition CylinderDomain.ghx (Grasshopper 1.0.8)
# plug-ins: Outdoor, Eddy3D

panel = Panel("""3
4.7
13""")
panel_2 = Panel("""28
72
144""")
select = SelectTemplate()
cylinder_domain = CylinderDomain(
    CoreCellSize=40,
    InnerCoreSize=-1,
    OuterRadius=-1,
    Height=-1,
    RadialMultiplier=2,
    CoreDivisions=1,
    RefinementBoxExtension=-1,
    RadialGrading=1,
    CoreRoundness=0.65,
    VerticalGrading=1)
atmospheric_boundary_layer = AtmosphericBoundaryLayer(
    WindDirections=panel_2,
    WindSpeed=panel,
    ReferenceHeight=10,
    RoughnessLengthZ0=1,
    GroundHeight=0,
    TurbulentKEK=0.015,
    TurbulentEpsilonΕ=0.135,
    TurbulentOmegaΩ=100)  # -> BoundaryConditions, WindVectors
mesh_settings = MeshSettings(
    RefinementBoxLevel=4,
    BuildingSurfaceLevel=4,
    BuildingFeatureLevel=3,
    GroundSurfaceLevel=2,
    LayerCount=5,
    AddLayers=False,
    Snap=True,
    GradingStrengthHorizontal=1,
    GradingStrengthVertical=1,
    AdaptiveGrading=False)
run_settings = RunSettings(
    Iterations=500,
    WriteInterval=20,
    KeepTimeSteps=3,
    TurbulenceModel="realizableKE",
    CPUCount=-1,
    SolverAlgorithm="SIMPLE",
    AgeOfAir=False,
    Robustness="4",
    PotentialFoamInit=True,
    WarmUpIterations=-1,
    FieldMonitors=False,
    PedestrianAverage=False,
    PressureCoefficient=False,
    Convergence=0.0001,
    AutoStopOnPlateau=False)  # -> RunSettings, DebugLogs
geometry = Geometry([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])
geometry_2 = Geometry(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)
tree = Tree(Geometry=geometry_2, Type="medium")
outdoor_case = OutdoorCase(
    CaseName="CylinderDomain",
    BoundaryConditions=atmospheric_boundary_layer.BoundaryConditions,
    DomainParameters=cylinder_domain,
    Buildings=geometry,
    Trees=tree,
    MeshSettings=mesh_settings,
    RunSettings=run_settings.RunSettings,
    WriteCase=True,
    ClearCase=False,
    AutoName="merry-lemur-dune-quill",
    PreviewDimensions=True,
    PreviewGrid3D=True,
    PreviewGroundGrid=True,
    PreviewRefinementBox=True,
    PreviewWindArrows=True)  # -> Logs, WriteLogs, Case, Domain, RefinementBox, Buildings
plot_residuals = PlotResiduals(Case=outdoor_case.Case, Plot=False, ResidualViewerTarget=0)
meshing_progress = MeshingProgress(Case=outdoor_case.Case, Live=True)  # -> Progress, Phase, Done, Status
live_residuals = LiveResiduals(Case=outdoor_case.Case, Live=True, DirectionDegrees=-1)
open_in_paraview = OpenInParaView(Case=outdoor_case.Case, Open=False, ComfortMetric=1, DirectionIndex=-1)
debrep = DeconstructBrep(Brep=outdoor_case.RefinementBox)  # -> Faces, Edges, Vertices
run = Run(
    Case=outdoor_case.Case,
    Mesh=Button(),
    CreateZones=Button(),
    Simulate=Button(),
    RunAll=False,
    Parallel=True,
    DirectionIndex=-1,
    ShowZones=True)
item = ListItem(List=debrep.Faces, Index=4, Wrap=True)
area = Area(Geometry=item)  # -> Area, Centroid
Z = UnitZ(Factor=Slider(2, range=0..10))
scale = Scale(Geometry=item, Center=area.Centroid, Factor=3)  # -> Geometry, Transform
move = Move(Geometry=scale.Geometry, Motion=Z)  # -> Geometry, Transform
brepgrid = BrepGridPoints(Geometry=move.Geometry, Spacing=5)  # -> Points, Status
probe = Probe(
    Case=outdoor_case.Case,
    Points=brepgrid.Points,
    Field="U",
    Run=False,
    AutoProbeName="polite-falcon-prairie-hammer",
    BakeTimeHistory=False,
    CullHugeVectors=True,
    CullInvalid=True,
    ShowRegion=False)  # -> Values, TimeSteps, SubResults
tree_branch = TreeBranch(Tree=simplify(probe.Values), Path=Slider(0, range=0..2), MaintainPaths=True)
amp = Amplitude(Vector=tree_branch, Amplitude=4)
cluster = Cluster(data=tree_branch)  # -> S, E, data_3
gradient = Gradient(
    LowerLimit=cluster.S,
    UpperLimit=cluster.E,
    Parameter=cluster.data_3,
    stops=[0.103: RGB(0, 0, 255), 0.22: RGB(0, 170, 255), 0.305: RGB(0, 255, 255), 0.398: RGB(0, 255, 188), 0.504: RGB(0, 255, 106), 0.605: RGB(91, 255, 0), 0.699: RGB(184, 255, 0), 0.799: RGB(255, 255, 0), 0.898: RGB(255, 170, 0)])
vdisex = VectorDisplayEx(Point=brepgrid.Points, Vector=amp, Colour=gradient, Width=Slider(3, range=0..10))

# ==== cluster Cluster
data = ClusterInput()
data_2 = Data(data)
data_3 = ClusterOutput(data_2)
bnd = Bounds(Numbers=data_2)
dedomain = DeconstructDomain(Domain=bnd)  # -> Start, End
S = ClusterOutput(dedomain.Start)
E = ClusterOutput(dedomain.End)
